# Grasshopper definition parametric pattern.gh (Grasshopper 1.0.7)

# curve 03
curve = Curve(<curve referenced from the Rhino model>)
# curve 04
curve_2 = Curve(<curve referenced from the Rhino model>)
# curve 02
curve_3 = Curve(<curve referenced from the Rhino model>)
# curve 01
# curve 01
curve_4 = Curve(<curve referenced from the Rhino model>)

series = Series(Start=8, Step=Slider(3.5, range=0..10), Count=Slider(10, range=0..10))
# Pattern 01
unit_x = UnitX(Factor=series)
reverse = Reverse(Vector=unit_x)
area = Area(Geometry=curve_4)  # -> Area, Centroid
bezier_span = BezierSpan(StartPoint=Point(0, 15, 0), StartTangent=unit_x, EndPoint=Point(15, 0, 0), EndTangent=reverse)  # -> Curve, Length, Domain
rotate = Rotate(Geometry=bezier_span.Curve, Angle=1.570796327, Plane=area.Centroid)  # -> Geometry, Transform
join_curves = JoinCurves(Curves=rotate.Geometry, Preserve=False)
join_curves_2 = JoinCurves(Curves=bezier_span.Curve, Preserve=False)
curve_5 = Curve(<curve referenced from the Rhino model>)
curve_6 = Curve(<curve referenced from the Rhino model>)
end_points = EndPoints(Curve=join_curves_2)  # -> Start, End
list_item = ListItem(List=rotate.Geometry, Index=Slider(10, range=0..10), Wrap=True)
point = Point(end_points.Start)
point_2 = Point(end_points.End)
merge = Merge(Data1=join_curves, Data2=curve_5, Data3=join_curves_2, Data4=curve_6)  # -> flatten(Result)

# ----
# Pattern 02
area_2 = Area(Geometry=curve_3)  # -> Area, Centroid
circle = Circle(Plane=area_2.Centroid, Radius=Slider(8, range=0..10))
area_3 = Area(Geometry=circle)  # -> Area, Centroid
divide_curve = DivideCurve(Curve=circle, Count=Slider(10, range=0..100), Kinks=False)  # -> Points, Tangents, Parameters
series_2 = Series(Start=0, Step=Slider(1, range=0..1), Count=Slider(8, range=0..10))  # -> graft(Series)
dispatch = Dispatch(List=divide_curve.Points, DispatchPattern=[True, False])  # -> ListA, ListB
vector_2pt = Vector2Pt(PointA=dispatch.ListA, PointB=area_3.Centroid, Unitize=False)  # -> Vector, Length
amplitude = Amplitude(Vector=vector_2pt.Vector, Amplitude=series_2)
point_3 = Point(dispatch.ListA)
move = Move(Geometry=dispatch.ListA, Motion=amplitude)  # -> Geometry, Transform
shift_list = ShiftList(List=move.Geometry, Shift=1, Wrap=True)
weave = Weave(Pattern=[0, 1], Stream0=dispatch.ListB, Stream1=shift_list, NullGaps=False)
interpolate = Interpolate(Vertices=weave, Degree=3, Periodic=True, KnotStyle=1)  # -> flatten(Curve), Length, Domain
join_curves_3 = JoinCurves(Curves=interpolate.Curve, Preserve=False)
end_points_2 = EndPoints(Curve=join_curves_3)  # -> Start, End
point_4 = Point(end_points_2.Start)

# ----
# Pattern 03
area_4 = Area(Geometry=curve)  # -> Area, Centroid
circle_2 = Circle(Plane=area_4.Centroid, Radius=Slider(8, range=0..10))
divide_curve_2 = DivideCurve(Curve=circle_2, Count=Slider(6, range=0..10), Kinks=False)  # -> Points, Tangents, Parameters
area_5 = Area(Geometry=circle_2)  # -> Area, Centroid
series_3 = Series(Start=0, Step=Slider(1, range=0..1), Count=Slider(5, range=0..10))  # -> graft(Series)
circle_3 = Circle(Plane=divide_curve_2.Points, Radius=series_3)
vector_2pt_2 = Vector2Pt(PointA=divide_curve_2.Points, PointB=area_5.Centroid, Unitize=False)  # -> Vector, Length
amplitude_2 = Amplitude(Vector=vector_2pt_2.Vector, Amplitude=series_3)
vector_display = VectorDisplay(Anchor=divide_curve_2.Points, Vector=amplitude_2)
move_2 = Move(Geometry=circle_3, Motion=amplitude_2)  # -> Geometry, Transform
number_slider = Slider(0, range=0..10)
list_item_2 = ListItem(List=move_2.Geometry, Index=Slider(0, range=0..10), Wrap=True)
join_curves_4 = JoinCurves(Curves=list_item_2, Preserve=False)
polar_array = PolarArray(Geometry=join_curves_4, Plane=area_5.Centroid, Count=Slider(6, range=0..10), Angle=6.283185307)  # -> Geometry, Transform

area_6 = Area(Geometry=curve_2)  # -> Area, Centroid
explode = Explode(Curve=curve_2, Recursive=True)  # -> Segments, Vertices
list_item_3 = ListItem(List=explode.Segments, Index=0, Wrap=True)
# Pattern 04
divide_curve_3 = DivideCurve(Curve=list_item_3, Count=Slider(4, range=0..10), Kinks=False)  # -> Points, Tangents, Parameters
dispatch_2 = Dispatch(List=divide_curve_3.Points, DispatchPattern=[True, False])  # -> ListA, ListB
unit_y = UnitY(Factor=1)
series_4 = Series(Start=0.5, Step=Slider(0.7, range=0..1), Count=Slider(6, range=0..10))  # -> graft(Series)
point_5 = Point(dispatch_2.ListB)
amplitude_3 = Amplitude(Vector=unit_y, Amplitude=series_4)
move_3 = Move(Geometry=point_5, Motion=amplitude_3)  # -> Geometry, Transform
unit_y_2 = UnitY(Factor=1)
weave_2 = Weave(Pattern=[0, 1], Stream0=dispatch_2.ListA, Stream1=move_3.Geometry, NullGaps=False)
interpolate_2 = Interpolate(Vertices=weave_2, Degree=Slider(10, range=0..10), Periodic=False, KnotStyle=1)  # -> Curve, Length, Domain
amplitude_4 = Amplitude(Vector=unit_y_2, Amplitude="10")
move_4 = Move(Geometry=interpolate_2.Curve, Motion=amplitude_4)  # -> Geometry, Transform
join_curves_5 = JoinCurves(Curves=move_4.Geometry, Preserve=False)
polar_array_2 = PolarArray(Geometry=join_curves_5, Plane=area_6.Centroid, Count=Slider(4, range=0..10), Angle=6.283185307)  # -> Geometry, Transform

# ----
# geometry 03
geometry = Geometry(polar_array.Geometry)
# geometry 04
geometry_2 = Geometry(polar_array_2.Geometry)
# geometry 02
geometry_3 = Geometry(join_curves_3)
# geometry 01
geometry_4 = Geometry(merge)
