# Grasshopper definition robot setting.gh (Grasshopper 1.0.7)
# plug-ins: Pufferfish, KUKA|prc - parametric robot control, LunchBox

# ---- group: sound controlled pattern
range = Range(Domain=Domain(0, 1), Steps=Slider(2, range=0..10))
panel = Panel(range)
number_slider = Slider(10, range=0..10)
number_slider_2 = Slider(10, range=0..10)
pt = Point(Point(0, 0, 0))
series = Series(Start=Slider(3, range=0..10), Step=range, Count=number_slider)  # -> flatten(Series)
panel_2 = Panel(series)
split_list = SplitList(List=series, Index=Slider(10, range=0..10))  # -> ListA, ListB
multiplication = Multiplication(A=split_list.ListB, B=Slider(7, range=0..100))
rectangle = Rectangle(Plane=pt, XSize=number_slider_2, YSize=number_slider_2, Radius=0)  # -> Rectangle, Length
cir = Circle(Plane=pt, Radius=multiplication)
item = ListItem(List=cir, Index=0, Wrap=True)
divide = DivideCurve(Curve=cir, Count=Slider(54, range=0..100), Kinks=False)  # -> simplify(Points), Tangents, Parameters
lng = ListLength(List=divide.Points)
random = Random(Range=Slider(100, range=0..100), Number=number_slider, Seed=2)
number_slider_3 = Slider(0.2, range=0..1)
panel_3 = Panel("""true
false""")
randomsplit = RandomSplitList(MasterList=simplify(divide.Points), Seed=simplify(graft(random)), Split=Slider(0.6, range=0..1))  # -> ListA, ListB
panel_4 = Panel(random)
vec2pt = Vector2Pt(PointA=randomsplit.ListA, PointB=pt, Unitize=False)  # -> Vector, Length
neg = Negative(Value=number_slider_3)
data = Data(randomsplit.ListA)
series_2 = Series(Start=number_slider_3, Step=number_slider_3, Count=number_slider)
lng_2 = ListLength(List=randomsplit.ListA)
multiplication_2 = Multiplication(A=vec2pt.Vector, B=number_slider_3)
random_2 = Random(Range=Domain(0, 1), Number=1, Seed=lng_2)
neg_2 = Negative(Value=multiplication_2)
multiplication_3 = Multiplication(A=neg_2, B=random_2)
move = Move(Geometry=data, Motion=multiplication_3)  # -> Geometry, Transform
merge = Merge(Data1=simplify(move.Geometry), Data2=simplify(randomsplit.ListB))
number_slider_4 = Slider(3, range=0..10)
alongcrv = SortAlongCurve(Points=merge, Curve=item)  # -> Points, Indices
points = PointList(Points=alongcrv.Points)
pline = PolyLine(Vertices=alongcrv.Points, Closed=False)  # -> flatten(Polyline)

# ----
panel_5 = Panel(multiplication)
align_curve_seams = AlignCurveSeams(Curves=cir, Snap=False, Iterative=True)  # -> Aligned, Points, ResultBoolean

# ---- group: sound controlled pattern (continued)
open_curve = OpenCurve(Curve=align_curve_seams.Aligned, Length=Slider(1, range=0..10), Normalized=False, Seam=0)  # -> Opened, ResultBoolean
dispatch = Dispatch(List=open_curve.Opened, DispatchPattern=panel_3)  # -> ListA, ListB
curve = Curve(dispatch.ListA)
curve_2 = Curve(dispatch.ListB)
flip_curve = FlipCurve(Curve=curve_2)  # -> Curve, Flag
weave = Weave(Pattern=[0, 1], Stream0=curve, Stream1=flip_curve.Curve, NullGaps=False)

# ----
rectangle_2 = Rectangle(Plane=PlaneXY(0, 0, 0), XSize=Slider(100, range=0..100), YSize=Slider(170, range=0..1000), Radius=0)  # -> Rectangle, Length
explode = Explode(Curve=rectangle_2.Rectangle, Recursive=True)  # -> Segments, Vertices
list_item = ListItem(List=explode.Segments, Index=Slider(1, range=0..10), Wrap=True)
list_item_2 = ListItem(List=explode.Segments, Index=Slider(0, range=0..10), Wrap=True)
curve_array = CurveArray(Geometry=list_item_2, Curve=list_item, Count=Slider(13, range=0..100))  # -> Geometry, Transform
panel_6 = Panel("""TRUE
FALSE""")
dispatch_2 = Dispatch(List=pline, DispatchPattern=panel_6)  # -> ListA, ListB
curve_3 = Curve(dispatch_2.ListA)
flip_curve_2 = FlipCurve(Curve=curve_3)  # -> Curve, Flag
curve_4 = Curve(dispatch_2.ListB)
weave_2 = Weave(Pattern=[0, 1], Stream0=flip_curve_2.Curve, Stream1=curve_4, NullGaps=False)
divide_distance = DivideDistance(Curve=weave_2, Distance=Slider(5, range=0..10))  # -> flatten(Points), Tangents, Parameters
point = Point(<point referenced from the Rhino model>)
group = Group(Objects=<curve referenced from the Rhino model>)
polyline = PolyLine(Vertices=divide_distance.Points, Closed=False)
orient = Orient(Geometry=group, Source=pt, Target=point)  # -> Geometry, Transform
ungroup = Ungroup(Group=orient.Geometry)
deconstruct_plane = DeconstructPlane(Plane=ungroup)  # -> Origin, XAxis, YAxis, ZAxis
rotate = Rotate(Geometry=deconstruct_plane.XAxis, Angle=degrees(Slider(162, range=0..1000)), Plane=PlaneXY(0, 0, 0))  # -> Geometry, Transform
panel_7 = Panel("true")
flip_plane = FlipPlane(Plane=ungroup, FlipX=False, FlipY=False, FlipZ="false")  # -> Flipped, ResultBoolean
plane = Plane(rotate.Geometry)
unit_y = UnitY(Factor=1)
rotate_3d = Rotate3D(Geometry=flip_plane.Flipped, Angle=degrees(Slider(419, range=0..1000)), Center=ungroup, Axis=unit_y)  # -> Geometry, Transform
digital_output_kuka_prc = DigitalOutputKUKAPrc(DigitalOutputNumber=Slider(1, range=0..10), OutputState="true", ContinuousMovement=True, ToolState=-1)  # -> flatten(KUKAPrcCommand)
digital_output_kuka_prc_2 = DigitalOutputKUKAPrc(DigitalOutputNumber=Slider(1, range=0..10), OutputState="false", ContinuousMovement=True, ToolState=-1)  # -> flatten(KUKAPrcCommand)
linear_movement_kuka_prc = LINearMovementKUKAPrc(TargetAsPlane=flip_plane.Flipped, extaxenabled=False, interpolation="C_DIS")  # -> flatten(KUKAPrcCommand)
geometry = Geometry(<mesh referenced from the Rhino model>)
custom_tool_kuka_prc = CustomToolKUKAPrc(
    CustomToolGeometry=geometry,
    toolid=10,
    toolvala=0,
    toolvalb=270,
    toolvalc=0,
    toolvalx=0,
    toolvaly=0,
    toolvalz=240,
    valuesset=True)
agilus_kr6_10_r1100_2_robot = AgilusKR610R11002Robot(infiniterot=False)
surface = Surface(<surface referenced from the Rhino model>)
merge_2 = Merge(Data1=digital_output_kuka_prc, Data2=linear_movement_kuka_prc, Data3=digital_output_kuka_prc_2)
kuka_prc_core = KUKAPrcCORE(
    SimulationSlider=Slider(0, range=0..1),
    KUKAPrcCommands=merge_2,
    Tool=custom_tool_kuka_prc,
    Robot=agilus_kr6_10_r1100_2_robot,
    CollisionGeometry=surface,
    PRC_BaseExpose=False,
    PRC_SaveNameExpose=False,
    PRCsettings="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")  # -> RobotGeometry, AnalysisOutput
