# Grasshopper definition sound interaction.gh (Grasshopper 1.0.7)
# plug-ins: Firefly.X, Firefly.Core

# Audio-Pattern
# point
point = Point(<point referenced from the Rhino model>)

sound_capture = SoundCapture(TimePeriod=0.1, StartStopSoundCapture=True)  # -> WavePressureSamplesFromLeftChannel, WavePressureSamplesFromRightChannel, Volume
timer = Timer(TimerInterval=20, Target=sound_capture)
smoothing_moving_average = SmoothingMovingAverage(Number=sound_capture.Volume, Samples=Slider(10, range=0..10))
remap_numbers = RemapNumbers(Value=smoothing_moving_average, Source=Slider(100, range=0..100), Target=Slider(1, range=0..1))  # -> Mapped, Clipped
panel = Panel(remap_numbers.Mapped)

multiplication = Multiplication(A=remap_numbers.Mapped, B=Slider(10, range=0..10))

unit_x = UnitX(Factor=1)
negative = Negative(Value=unit_x)
circle = Circle(Plane=point, Radius=1)
move = Move(Geometry=circle, Motion=negative)  # -> Geometry, Transform
series = Series(Start=multiplication, Step=Slider(0.9, range=0..1), Count=Slider(10, range=0..10))
end_points = EndPoints(Curve=move.Geometry)  # -> Start, End
scale = Scale(Geometry=move.Geometry, Center=point, Factor=series)  # -> Geometry, Transform
polar_array = PolarArray(Geometry=scale.Geometry, Plane=point, Count=Slider(6, range=0..10), Angle=6.283185307)  # -> Geometry, Transform
